# Grasshopper definition Json Generation.gh (Grasshopper 1.0.7)
# plug-ins: BH.UI.Grasshopper

getinfo = GetInfo(Component="{ .GetInfo")
# <Script name>
project_number = Panel("")
setprojectid = SetProjectID(ProjectID=project_number, Component="{ .SetProjectID")
bhom_version_used_to_create = Panel("8.2")
bhom_version_currently_installed = Panel(getinfo)
bhomtypelist = BHoMTypeList(Component="{ .BHoMTypeList")
createtype = CreateType(Component="BH.oM.Geometry.IGeometry")
c_script = CSharpScript(x=bhomtypelist, y=createtype)  # -> out, A; inputs x: list
# ---------- c_script: C# usings ----------
using System.Linq;
# ---------- c_script: C# ----------
    A = x.Where(t => (y as Type).IsAssignableFrom(t as Type));
# ---------- end c_script ----------
tsort = SortText(Keys=c_script.A, Culture=127)  # -> Keys, Values
panel = Panel(tsort.Keys)
number_slider = Slider(3, range=0..10)
polygon = Polygon(Plane=PlaneXY(0, 0, 0), Radius=3, Segments=Slider(4, range=0..10), FilletRadius=0)  # -> Polygon, Length
# Geometry_oM
number_slider_2 = Slider(5, range=0..10)
point = Point(X=0, Y=0, Z=Slider(10, range=0..10), Component="{ .Point")
series = Series(Start=0, Step=1, Count=Slider(5, range=0..10))
bhomgeo = BHoMGeometry(
    polygon.Polygon,
    ObjectType="{ \"_t\" : \"System.Type\", \"Name\" : \"System.Object, mscorlib, Version=4.0.0.0, Culture=neutral, PublicKeyToken=b77a5c561934e089\", \"_bhomVersion\" : \"8.2\" }",
    m_ForcePreview=False,
    m_MaxItemsPreview=10000)
number_slider_3 = Slider(10, range=0..10)
crv = Curve([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])
multiplication = Multiplication(A=number_slider, B=2)
point_2 = Point(X=0, Y=0, Z=Slider(10, range=0..10), Component="{ .Point")
explode = Explode(Object=bhomgeo, Component="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")
rad = Radians(Degrees=Slider(180, range=0..1000))
line = Line(
    Start="{ \"_t\" : \"BH.oM.Geometry.Point\", \"X\" : 0.0, \"Y\" : 0.0, \"Z\" : 0.0, \"_bhomVersion\" : \"8.2\" }",
    End=point,
    Infinite=False,
    Component="BH.oM.Geometry.Line")
isubparts = ISubParts(Geometry=crv, Component="{ .ISubParts")  # -> flatten(I)
X = UnitX(Factor=1)
Y = UnitY(Factor=1)
crv_2 = Curve([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])
X_2 = UnitX(Factor=series)
srf = Surface(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)
crv_3 = Curve([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])
crv_4 = Curve(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)
brep = Brep(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)
rectangle = Rectangle(Plane=PlaneXY(0, 0, 0), XSize=multiplication, YSize=multiplication, Radius=0)  # -> Rectangle, Length
point_3 = Point(X=0, Y=0, Z=0, Component="{ .Point")
line_2 = Line(
    Start="{ \"_t\" : \"BH.oM.Geometry.Point\", \"X\" : 0.0, \"Y\" : 0.0, \"Z\" : 0.0, \"_bhomVersion\" : \"8.2\" }",
    End=point_2,
    Infinite=False,
    Component="BH.oM.Geometry.Line")
point_4 = Point(X=number_slider_3, Y=number_slider_3, Z=Slider(5, range=0..10), Component="{ .Point")
point_5 = Point(X=0, Y=0, Z=Slider(10, range=0..10), Component="{ .Point")
point_6 = Point(X=0, Y=0, Z=0, Component="BH.oM.Geometry.Point")
X_3 = UnitX(Factor=1)
planarsurface = PlanarSurface(BoundaryCurves=crv_2, Tolerance=1e-06, Component="{ .PlanarSurface")
Y_2 = UnitY(Factor=1)
move = Move(Geometry=line, Motion=X_2)  # -> Geometry, Transform
move_2 = Move(Motion=Vector(0, 0, 10))  # -> Geometry, Transform
crv_5 = Curve(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)
boundarycurve = BoundaryCurve(Curves=crv_3, Tolerance=1e-06, Component="{ .BoundaryCurve")
mplane = MeshPlane(Boundary=rectangle.Rectangle, WidthCount=number_slider, HeightCount=number_slider)  # -> Mesh, Area
ijoin = IJoin(Curves=isubparts, Tolerance=1e-06, Component="{ .IJoin")
arc = Arc(
    CoordinateSystem="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",
    Radius=number_slider_2,
    StartAngle=0,
    EndAngle=rad,
    Component="BH.oM.Geometry.Arc")
cuboid = Cuboid(
    CoordinateSystem="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",
    Length=Slider(2, range=0..10),
    Depth=Slider(3, range=0..10),
    Height=Slider(5, range=0..10),
    Component="BH.oM.Geometry.Cuboid")
polygon_2 = Polygon(Vertices=explode, Tolerance=1e-06, Component="{ .Polygon")
torus = Torus(
    Centre="{ \"_t\" : \"BH.oM.Geometry.Point\", \"X\" : 0.0, \"Y\" : 0.0, \"Z\" : 0.0, \"_bhomVersion\" : \"8.2\" }",
    Axis="{ \"_t\" : \"BH.oM.Geometry.Vector\", \"X\" : 0.0, \"Y\" : 0.0, \"Z\" : 1.0, \"_bhomVersion\" : \"8.2\" }",
    RadiusMajor=Slider(5, range=0..10),
    RadiusMinor=Slider(1, range=0..1),
    Component="BH.oM.Geometry.Torus")
ellipse = Ellipse(Centre=point_3, Radius1=Slider(3, range=0..10), Radius2=Slider(5, range=0..10), Component="{ .Ellipse")
pipe = Pipe(Centreline=line_2, Radius=Slider(2, range=0..10), Capped=True, Component="BH.oM.Geometry.Pipe")
circle = Circle(
    Centre="{ \"_t\" : \"BH.oM.Geometry.Point\", \"X\" : 0.0, \"Y\" : 0.0, \"Z\" : 0.0, \"_bhomVersion\" : \"8.2\" }",
    Normal="{ \"_t\" : \"BH.oM.Geometry.Vector\", \"X\" : 0.0, \"Y\" : 0.0, \"Z\" : 1.0, \"_bhomVersion\" : \"8.2\" }",
    Radius=Slider(5, range=0..10),
    Component="BH.oM.Geometry.Circle")
extrusion = Extrusion(
    Curve=circle,
    Direction="{ \"_t\" : \"BH.oM.Geometry.Vector\", \"X\" : 0.0, \"Y\" : 0.0, \"Z\" : 1.0, \"_bhomVersion\" : \"8.2\" }",
    Capped=True,
    Component="BH.oM.Geometry.Extrusion")
plane = Plane(
    Origin="{ \"_t\" : \"BH.oM.Geometry.Point\", \"X\" : 0.0, \"Y\" : 0.0, \"Z\" : 0.0, \"_bhomVersion\" : \"8.2\" }",
    Normal="{ \"_t\" : \"BH.oM.Geometry.Vector\", \"X\" : 0.0, \"Y\" : 0.0, \"Z\" : 1.0, \"_bhomVersion\" : \"8.2\" }",
    Component="BH.oM.Geometry.Plane")
cone = Cone(
    Centre="{ \"_t\" : \"BH.oM.Geometry.Point\", \"X\" : 0.0, \"Y\" : 0.0, \"Z\" : 0.0, \"_bhomVersion\" : \"8.2\" }",
    Axis="{ \"_t\" : \"BH.oM.Geometry.Vector\", \"X\" : 0.0, \"Y\" : 0.0, \"Z\" : 1.0, \"_bhomVersion\" : \"8.2\" }",
    Radius=Slider(3, range=0..10),
    Height=Slider(8, range=0..10),
    Component="BH.oM.Geometry.Cone")
cylinder = Cylinder(
    Centre="{ \"_t\" : \"BH.oM.Geometry.Point\", \"X\" : 0.0, \"Y\" : 0.0, \"Z\" : 0.0, \"_bhomVersion\" : \"8.2\" }",
    Axis="{ \"_t\" : \"BH.oM.Geometry.Vector\", \"X\" : 0.0, \"Y\" : 0.0, \"Z\" : 1.0, \"_bhomVersion\" : \"8.2\" }",
    Radius=Slider(3, range=0..10),
    Height=Slider(8, range=0..10),
    Component="BH.oM.Geometry.Cylinder")
line_3 = Line(
    Start="{ \"_t\" : \"BH.oM.Geometry.Point\", \"X\" : 0.0, \"Y\" : 0.0, \"Z\" : 0.0, \"_bhomVersion\" : \"8.2\" }",
    End=point_5,
    Infinite=False,
    Component="BH.oM.Geometry.Line")
loft = Loft(Curves=move.Geometry, Component="BH.oM.Geometry.Loft")
sphere = Sphere(
    Centre="{ \"_t\" : \"BH.oM.Geometry.Point\", \"X\" : 0.0, \"Y\" : 0.0, \"Z\" : 0.0, \"_bhomVersion\" : \"8.2\" }",
    Radius=Slider(5, range=0..10),
    Component="BH.oM.Geometry.Sphere")
cartesiancoordinatesystem = CartesianCoordinateSystem(Origin=point_6, X=X_3, Y=Y_2, Component="{ .CartesianCoordinateSystem")
basis = Basis(X=X, Y=Y, Component="{ .Basis")
boundingbox = BoundingBox(
    Min="{ \"_t\" : \"BH.oM.Geometry.Point\", \"X\" : 0.0, \"Y\" : 0.0, \"Z\" : 0.0, \"_bhomVersion\" : \"8.2\" }",
    Max=point_4,
    Component="BH.oM.Geometry.BoundingBox")
quaternion = Quaternion(X=0, Y=0, Z=0, W=0, Component="BH.oM.Geometry.Quaternion")
vector = Vector(X=0, Y=0, Z=Slider(10, range=0..10), Component="BH.oM.Geometry.Vector")
face = Face(A=0, B=Slider(1, range=0..1), C=Slider(2, range=0..10), D=Slider(3, range=0..10), Component="BH.oM.Geometry.Face")
point_7 = Point(X="1", Y="2", Z="3", Component="BH.oM.Geometry.Point")
bhomgeo_2 = BHoMGeometry(
    brep,
    ObjectType="{ \"_t\" : \"System.Type\", \"Name\" : \"System.Object, mscorlib, Version=4.0.0.0, Culture=neutral, PublicKeyToken=b77a5c561934e089\", \"_bhomVersion\" : \"8.2\" }",
    m_ForcePreview=False,
    m_MaxItemsPreview=10000)
bhomgeo_3 = BHoMGeometry(
    mplane.Mesh,
    ObjectType="{ \"_t\" : \"System.Type\", \"Name\" : \"System.Object, mscorlib, Version=4.0.0.0, Culture=neutral, PublicKeyToken=b77a5c561934e089\", \"_bhomVersion\" : \"8.2\" }",
    m_ForcePreview=False,
    m_MaxItemsPreview=10000)
bhomgeo_4 = BHoMGeometry(
    crv_4,
    ObjectType="{ \"_t\" : \"System.Type\", \"Name\" : \"System.Object, mscorlib, Version=4.0.0.0, Culture=neutral, PublicKeyToken=b77a5c561934e089\", \"_bhomVersion\" : \"8.2\" }",
    m_ForcePreview=False,
    m_MaxItemsPreview=10000)
bhomgeo_5 = BHoMGeometry(
    srf,
    ObjectType="{ \"_t\" : \"System.Type\", \"Name\" : \"System.Object, mscorlib, Version=4.0.0.0, Culture=neutral, PublicKeyToken=b77a5c561934e089\", \"_bhomVersion\" : \"8.2\" }",
    m_ForcePreview=False,
    m_MaxItemsPreview=10000)
bhomgeo_6 = BHoMGeometry(
    crv_5,
    ObjectType="{ \"_t\" : \"System.Type\", \"Name\" : \"System.Object, mscorlib, Version=4.0.0.0, Culture=neutral, PublicKeyToken=b77a5c561934e089\", \"_bhomVersion\" : \"8.2\" }",
    m_ForcePreview=False,
    m_MaxItemsPreview=10000)
bhomgeo_7 = BHoMGeometry(
    move_2.Transform,
    ObjectType="{ \"_t\" : \"System.Type\", \"Name\" : \"System.Object, mscorlib, Version=4.0.0.0, Culture=neutral, PublicKeyToken=b77a5c561934e089\", \"_bhomVersion\" : \"8.2\" }",
    m_ForcePreview=False,
    m_MaxItemsPreview=10000)
merge = Merge(
    Data1=arc,
    Data2=basis,
    Data3=boundarycurve,
    Data4=bhomgeo_2,
    Data5=boundingbox,
    Data6=circle,
    Data7=cone,
    Data8=cartesiancoordinatesystem,
    Data9=cuboid,
    Data10=cylinder,
    Data11=ellipse,
    Data12=extrusion,
    Data13=face,
    Data14=line_3,
    Data15=loft,
    Data16=bhomgeo_3,
    Data17=bhomgeo_4,
    Data18=bhomgeo_5,
    Data19=pipe,
    Data20=planarsurface,
    Data21=plane,
    Data22=point_7,
    Data23=ijoin,
    Data24=polygon_2,
    Data25=bhomgeo_6,
    Data26=quaternion,
    Data27=sphere,
    Data28=torus,
    Data29=bhomgeo_7,
    Data30=vector)  # -> flatten(Result)
number_slider_4 = Slider(3, range=0..10)
type = ObjectType(
    bhomtypelist,
    ObjectType="{ \"_t\" : \"System.Type\", \"Name\" : \"System.Object, mscorlib, Version=4.0.0.0, Culture=neutral, PublicKeyToken=b77a5c561934e089\", \"_bhomVersion\" : \"8.2\" }",
    m_ForcePreview=False,
    m_MaxItemsPreview=10000)
concrete = Concrete(
    {"C12/15": 0, "C16/20": 1, "C20/25": 2, "C25/30": 3, "C30/37": 4, "C35/45": 5, "C40/50": 6, "C45/55": 7, "C50/60": 8, "C55/67": 9, "C60/75": 10, "C70/85": 11, "C80/95": 12, "C90/105": 13}, selected="C30/37",
    Component="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",
    Selection=4)
# Structure_oM
c_script_2 = CSharpScript(x=type, y="Structure_oM")  # -> out, A; inputs x: list, y: String
# ---------- c_script_2: C# usings ----------
using System.Linq;
using System.Reflection;
# ---------- c_script_2: C# ----------
    A = x.Where(t => IsIncluded(t as Type, y));
# ---------- c_script_2: C# additional code ----------
  private bool IsIncluded(Type type, string ns)
  {


    if(type.IsInterface || type.IsAbstract)
      return false;

    if(type.IsEnum)
      return false;


    
    return type.Assembly.GetName().Name == ns;
    //    Assembly ass = type.Assembly;
    //
    //    //    foreach (var item in ass.GetCustomAttributes())
    //    //    {
    //    //      Print(item.GetType().Name);
    //    //    }
    //
    //    AssemblyDescriptionAttribute descAtr = ass.GetCustomAttributes().OfType<AssemblyDescriptionAttribute>().FirstOrDefault();
    //    if(descAtr == null)
    //    {
    //      Print("No desc");
    //      return false;
    //    }
    //
    //    return descAtr.Description.Contains("github.com/BHoM/");
  }
# ---------- end c_script_2 ----------
panel_2 = Panel(c_script_2.A)
multiplication_2 = Multiplication(A=number_slider_4, B=2)
concretecircularsection = ConcreteCircularSection(Diameter=Slider(0.5, range=0..1), Component="{ .ConcreteCircularSection")
constraint4dof = Constraint4DOF(
    TranslationX="{ \"_t\" : \"System.Enum\", \"TypeName\" : { \"_t\" : \"System.Type\", \"Name\" : \"BH.oM.Structure.Constraints.DOFType\", \"_bhomVersion\" : \"8.2\" }, \"Value\" : \"Free\", \"_bhomVersion\" : \"8.2\" }",
    TranslationY="{ \"_t\" : \"System.Enum\", \"TypeName\" : { \"_t\" : \"System.Type\", \"Name\" : \"BH.oM.Structure.Constraints.DOFType\", \"_bhomVersion\" : \"8.2\" }, \"Value\" : \"Free\", \"_bhomVersion\" : \"8.2\" }",
    TranslationZ="{ \"_t\" : \"System.Enum\", \"TypeName\" : { \"_t\" : \"System.Type\", \"Name\" : \"BH.oM.Structure.Constraints.DOFType\", \"_bhomVersion\" : \"8.2\" }, \"Value\" : \"Free\", \"_bhomVersion\" : \"8.2\" }",
    RotationX="{ \"_t\" : \"System.Enum\", \"TypeName\" : { \"_t\" : \"System.Type\", \"Name\" : \"BH.oM.Structure.Constraints.DOFType\", \"_bhomVersion\" : \"8.2\" }, \"Value\" : \"Free\", \"_bhomVersion\" : \"8.2\" }",
    TranslationalStiffnessX=0,
    TranslationalStiffnessY=0,
    TranslationalStiffnessZ=0,
    RotationalStiffnessX=0,
    Component="BH.oM.Structure.Constraints.Constraint4DOF")
constraint6dof = Constraint6DOF(
    TranslationalStiffnessX=0,
    TranslationalStiffnessY=0,
    TranslationalStiffnessZ=0,
    RotationalStiffnessX=0,
    RotationalStiffnessY=0,
    RotationalStiffnessZ=0,
    TranslationX="{ \"_t\" : \"System.Enum\", \"TypeName\" : { \"_t\" : \"System.Type\", \"Name\" : \"BH.oM.Structure.Constraints.DOFType\", \"_bhomVersion\" : \"8.2\" }, \"Value\" : \"Free\", \"_bhomVersion\" : \"8.2\" }",
    TranslationY="{ \"_t\" : \"System.Enum\", \"TypeName\" : { \"_t\" : \"System.Type\", \"Name\" : \"BH.oM.Structure.Constraints.DOFType\", \"_bhomVersion\" : \"8.2\" }, \"Value\" : \"Free\", \"_bhomVersion\" : \"8.2\" }",
    TranslationZ="{ \"_t\" : \"System.Enum\", \"TypeName\" : { \"_t\" : \"System.Type\", \"Name\" : \"BH.oM.Structure.Constraints.DOFType\", \"_bhomVersion\" : \"8.2\" }, \"Value\" : \"Free\", \"_bhomVersion\" : \"8.2\" }",
    RotationX="{ \"_t\" : \"System.Enum\", \"TypeName\" : { \"_t\" : \"System.Type\", \"Name\" : \"BH.oM.Structure.Constraints.DOFType\", \"_bhomVersion\" : \"8.2\" }, \"Value\" : \"Free\", \"_bhomVersion\" : \"8.2\" }",
    RotationY="{ \"_t\" : \"System.Enum\", \"TypeName\" : { \"_t\" : \"System.Type\", \"Name\" : \"BH.oM.Structure.Constraints.DOFType\", \"_bhomVersion\" : \"8.2\" }, \"Value\" : \"Free\", \"_bhomVersion\" : \"8.2\" }",
    RotationZ="{ \"_t\" : \"System.Enum\", \"TypeName\" : { \"_t\" : \"System.Type\", \"Name\" : \"BH.oM.Structure.Constraints.DOFType\", \"_bhomVersion\" : \"8.2\" }, \"Value\" : \"Free\", \"_bhomVersion\" : \"8.2\" }",
    Component="BH.oM.Structure.Constraints.Constraint6DOF")
rectangle_2 = Rectangle(Plane=PlaneXY(0, 0, 0), XSize=multiplication_2, YSize=multiplication_2, Radius=0)  # -> Rectangle, Length
constantthickness = ConstantThickness(
    Thickness=Slider(0.1, range=0..0.1),
    Material=concrete,
    PanelType="{ \"_t\" : \"System.Enum\", \"TypeName\" : { \"_t\" : \"System.Type\", \"Name\" : \"BH.oM.Structure.SurfaceProperties.PanelType\", \"_bhomVersion\" : \"8.2\" }, \"Value\" : \"Slab\", \"_bhomVersion\" : \"8.2\" }",
    Component="BH.oM.Structure.SurfaceProperties.ConstantThickness")
barreleasefixfix = BarReleaseFixFix(Name="FixFix", Component="{ .BarReleaseFixFix")
mplane_2 = MeshPlane(Boundary=rectangle_2.Rectangle, WidthCount=number_slider_4, HeightCount=number_slider_4)  # -> Mesh, Area
xy = XYPlane(Origin=Point(0, 0, 0))
crv_6 = Curve(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)
pt = ConstructPoint(XCoordinate=0, YCoordinate=0, ZCoordinate=0)
crv_7 = Curve(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)
crv_8 = Curve(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)
bhomgeo_8 = BHoMGeometry(
    mplane_2.Mesh,
    ObjectType="{ \"_t\" : \"System.Type\", \"Name\" : \"System.Object, mscorlib, Version=4.0.0.0, Culture=neutral, PublicKeyToken=b77a5c561934e089\", \"_bhomVersion\" : \"8.2\" }",
    m_ForcePreview=False,
    m_MaxItemsPreview=10000)
X_4 = UnitX(Factor=1)
# Elements
crv_9 = Curve([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])
X_5 = UnitX(Factor=1)
line_4 = Line(crv_7)
bar = Bar(
    Line=crv_6,
    SectionProperty=concretecircularsection,
    OrientationAngle=0,
    Release=barreleasefixfix,
    FeaType="{ \"_t\" : \"System.Enum\", \"TypeName\" : { \"_t\" : \"System.Type\", \"Name\" : \"BH.oM.Structure.Elements.BarFEAType\", \"_bhomVersion\" : \"8.2\" }, \"Value\" : \"Flexural\", \"_bhomVersion\" : \"8.2\" }",
    Component="{ .Bar")
femesh = FEMesh(Mesh=bhomgeo_8, Property=constantthickness, LocalX=X_5, Component="{ .FEMesh")
node = Node(Position=pt, Orientation=xy, Support=constraint6dof, Component="BH.oM.Structure.Elements.Node")
panel_3 = Panel(Outlines=crv_9, Property=constantthickness, LocalX=X_4, Tolerance=1e-06, Component="{ .Panel")
opening = Opening(Edges=crv_8, Component="{ .Opening")
edge = Edge(Curve=line_4, Release=constraint4dof, Support=constraint6dof, Component="BH.oM.Structure.Elements.Edge")
merge_2 = Merge(Data1=panel_3, Data2=opening, Data3=edge, Data4=node, Data5=bar, Data6=femesh)  # -> flatten(Result)
c_script_3 = CSharpScript(x=merge_2)  # -> out, A
# ---------- c_script_3: C# ----------
    A = x.GetType().Name + " Name";
# ---------- end c_script_3 ----------
setproperty = SetProperty(Obj=merge_2, PropName="Name", Value=c_script_3.A, Component="{ .SetPropertyValue")
merge_3 = Merge(Data1=flatten(merge), Data2=flatten(setproperty))  # -> flatten(Result)
iobject = BHIObject(
    graft(merge_3),
    ObjectType="{ \"_t\" : \"System.Type\", \"Name\" : \"System.Object, mscorlib, Version=4.0.0.0, Culture=neutral, PublicKeyToken=b77a5c561934e089\", \"_bhomVersion\" : \"8.2\" }",
    m_ForcePreview=False,
    m_MaxItemsPreview=10000)
c_script_4 = CSharpScript()  # -> out, A
# ---------- c_script_4: C# ----------
    A = GrasshopperDocument.FilePath;
# ---------- end c_script_4 ----------
c_script_5 = CSharpScript(x=c_script_4.A, y=iobject)  # -> out, A; inputs x: String
# ---------- c_script_5: C# ----------
    string[] split = x.Split('\\');
    string basePath = string.Join("\\", split.Take(split.Length - 2)) + "\\SchemaDocumentationGenerator\\JsonExamples";
    A = basePath + "\\" + y.GetType().Assembly.GetName().Name + "\\" + y.GetType().Name + ".json";
# ---------- end c_script_5 ----------
pushconfig = PushConfig(
    UseDatasetSerialization=Toggle(True),
    SkipUnsupportedTypes=False,
    BeautifyJson=Toggle(False),
    DisableWarnings=False,
    WrapNonBHoMObjects=False,
    AllowHashForComparing=False,
    DiffingConfig="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",
    Component="BH.oM.Adapters.File.PushConfig")
fileadapter = FileAdapter(TargetLocation=c_script_5.A, Component="{ ..ctor")
panel_4 = Panel(c_script_5.A)
pushtype = PushType(
    {"FullPush": 0, "CreateOnly": 1, "CreateNonExisting": 2, "UpdateOnly": 3, "UpdateOrCreateOnly": 4, "DeleteThenCreate": 5, "AdapterDefault": 6}, selected="DeleteThenCreate",
    Component="BH.oM.Adapter.PushType",
    Selection=5)
push = Push(Adapter=fileadapter, Objects=iobject, PushType=pushtype, ActionConfig=pushconfig, Active=Button(), Component="{ .Push")  # -> Objects, Success
